# Grasshopper definition branching_01.gh (Grasshopper 1.0.7)
# plug-ins: Anemone

point = Point("0,0,0")
number_slider = Slider(8, range=0..10)

# ---- group: 01
v1 = CSharpScript(o=point, xnum=number_slider, ynum=number_slider)  # -> out, A, B, C; inputs o: Point3d, xnum: Double, ynum: Double
# ---------- v1: C# ----------
    double step = 0.5;

    var xvar = new List<double>();
    var yvar = new List<double>();

    //need a list to hold potential vectors...
    var pot = new List<Vector3d>();

    for(int i = 0; i < xnum; i++){
      double xpos = step * (i + 1);
      xvar.Add(xpos);
      yvar.Add(xpos);

      double potz = 1;

      double potx = xvar[i];
      double poty = yvar[i];
      Vector3d a = new Vector3d(potx, 0, potz);
      Vector3d b = new Vector3d(0, poty, potz);
      Vector3d c = new Vector3d(-potx, 0, potz);
      Vector3d d = new Vector3d(0, -poty, potz);
      pot.Add(a);
      pot.Add(b);
      pot.Add(c);
      pot.Add(d);
    }

    int potnum = pot.Count;
    //can I add a z value for each vector in my list?

    //foreach(var pots in pot){
    //Vector3d t = new Vector3d(x, y, z);
    //pot.Add(t)
    //for(var i = 0; i < 15; i++){
    //A = xvar + i * test;}
    Vector3d[] array = pot.ToArray();

    A = pot;
    B = potnum;
    C = array;

    String debugvector = array.ToString();
    //String debug1 = num.ToString();
    //String debug2 = xvar.ToString();
    Print(debugvector);
# ---------- end v1 ----------

# ----
number_slider_2 = Slider(3, range=0..10)

# ---- group: Loop
fast_loop_start = FastLoopStart(Iterations=Slider(4, range=0..4), Data=point)  # -> port, Counter, Data

# ----
c_script = CSharpScript(
    data=fast_loop_start.Data,
    branch=Slider(4, range=0..10),
    count=fast_loop_start.Counter,
    xnum=number_slider,
    ynum=number_slider)  # -> out, potVec, selVec, selVec_id; inputs data: Point3d, branch: Int32, count: Int32, xnum: Double, ynum: Double
# ---------- c_script: C# ----------
    double step = 0.5;

    var xvar = new List<double>();
    var yvar = new List<double>();

    //need a list to hold potential vectors...
    var pot = new List<Vector3d>();

    //need a seed generator...
    var seed = new Random(count);

    //int seed = rnd * count;
    //need amount chosen and a list to hold chosen indeces...
    var selid = new List<int>();
    var sel = new List<Vector3d>();

    for(int i = 0; i < xnum; i++){
      double xpos = step * (i + 1);
      xvar.Add(xpos);
      yvar.Add(xpos);

      double potz = 5;

      double potx = xvar[i];
      double poty = yvar[i];
      Vector3d a = new Vector3d(potx, 0, potz);
      Vector3d b = new Vector3d(0, poty, potz);
      Vector3d c = new Vector3d(-potx, 0, potz);
      Vector3d d = new Vector3d(0, -poty, potz);
      pot.Add(a);
      pot.Add(b);
      pot.Add(c);
      pot.Add(d);
    }

    for(int i = 1; i <= branch; i++){
      int rIndex = seed.Next(pot.Count);
      var item = pot[rIndex];
      sel.Add(item);
      selid.Add(rIndex);
    }

    //int rIndex = seed.Next(pot.Count);

    int potnum = pot.Count;
    //can I add a z value for each vector in my list?

    //foreach(var pots in pot){
    //Vector3d t = new Vector3d(x, y, z);
    //pot.Add(t)
    //for(var i = 0; i < 15; i++){
    //A = xvar + i * test;}
    Vector3d[] array = pot.ToArray();



    //foreach(int selected in pot){}

    potVec = pot;
    selVec = sel;
    selVec_id = selid;

    String debugvector = seed.ToString();
    //String debug1 = num.ToString();
    //String debug2 = xvar.ToString();
    Print(debugvector);
# ---------- end c_script ----------
geometry = Geometry(c_script.potVec)
move = Move(Geometry=graft(fast_loop_start.Data), Motion=c_script.selVec)  # -> Geometry, Transform
panel = Panel(c_script.selVec)

# ----
# 2 Systems -
# Flat & Grafted
geometry_2 = Geometry(flatten(move.Geometry))
geometry_3 = Geometry(move.Geometry)

# ---- group: Loop (continued)
fast_loop_end = FastLoopEnd(port=fast_loop_start.port, Exit=False, Data=geometry_2, RecordData=True, TimeOutVal=0)

# ----
panel_3 = Panel(fast_loop_end)
geometry_4 = Geometry(fast_loop_end)
geometry_5 = Geometry(flatten(fast_loop_end))
list_length = ListLength(List=geometry_5)

# ---- group: For Graft
series = Series(Start=0, Step=1, Count=10)
list_length_2 = ListLength(List=geometry_5)
repeat_data = RepeatData(Data=series, Length=list_length_2)
member_index = MemberIndex(Set=repeat_data, Member=series)  # -> simplify(Index), Count
repeat_data_2 = RepeatData(Data=point, Length=list_length_2)  # -> graft(Data)
list_item = ListItem(List=geometry_5, Index=member_index.Index, Wrap=True)
insert_items = InsertItems(List=list_item, Item=repeat_data_2, Indices=0, Wrap=True)

# ---- group: For Flat
tree_statistics = TreeStatistics(Tree=geometry_4)  # -> Paths, Length, Count
bounds = Bounds(Numbers=tree_statistics.Length)
deconstruct_domain = DeconstructDomain(Domain=bounds)  # -> Start, End
division = Division(A=deconstruct_domain.End, B=tree_statistics.Length)  # -> simplify(graft(Result))
duplicate_data = DuplicateData(Data=simplify(geometry_4), Number=division, Order=True)
series_2 = Series(Start=0, Step=1, Count=deconstruct_domain.End)
geometry_6 = Geometry(point)
tree_item = TreeItem(Tree=duplicate_data, Path=tree_statistics.Paths, Index=graft(series_2), Wrap=True)
insert_items_2 = InsertItems(List=tree_item, Item=geometry_6, Indices="0", Wrap=True)  # -> simplify(List)

# ----
panel_4 = Panel(list_length)
nurbs_curve = NurbsCurve(Vertices=insert_items, Degree=number_slider_2, Periodic=False)  # -> Curve, Length, Domain
cull_duplicates = CullDuplicates(Points=geometry_4, Tolerance=0.1, CullMode=3)  # -> Points, Indices, Valence
list_length_3 = ListLength(List=flatten(insert_items_2))  # -> flatten(Length)
nurbs_curve_2 = NurbsCurve(Vertices=insert_items_2, Degree=number_slider_2, Periodic=False)  # -> Curve, Length, Domain
list_length_4 = ListLength(List=flatten(cull_duplicates.Points))  # -> flatten(Length)
simplify_tree = SimplifyTree(Tree=nurbs_curve_2.Curve, Front=False)
pipe = Pipe(Curve=nurbs_curve_2.Curve, Radius=Slider(0.02, range=0..0.2), Caps=2)  # disabled
panel_5 = Panel(list_length_4)
list_length_5 = ListLength(List=flatten(simplify_tree))  # -> flatten(Length)
panel_6 = Panel(list_length_5)
