# Grasshopper definition branching_02.gh (Grasshopper 1.0.7)
# plug-ins: Anemone

number_slider = Slider(2, range=0..5)
number_slider_2 = Slider(2, range=0..5)
point = Point("0,0,0")
negative = Negative(Value=number_slider)
negative_2 = Negative(Value=number_slider)
vector_xyz = VectorXYZ(XComponent=negative_2, YComponent=0, ZComponent=number_slider_2)  # -> Vector, Length
vector_xyz_2 = VectorXYZ(XComponent=number_slider, YComponent=0, ZComponent=number_slider_2)  # -> Vector, Length
vector_xyz_3 = VectorXYZ(XComponent=0, YComponent=negative, ZComponent=number_slider_2)  # -> Vector, Length
vector_xyz_4 = VectorXYZ(XComponent=0, YComponent=0, ZComponent=number_slider_2)  # -> Vector, Length
vector_xyz_5 = VectorXYZ(XComponent=0, YComponent=number_slider, ZComponent=number_slider_2)  # -> Vector, Length
merge = Merge(
    Data1=vector_xyz_4.Vector,
    Data2=vector_xyz_5.Vector,
    Data3=vector_xyz_3.Vector,
    Data4=vector_xyz_2.Vector,
    Data5=vector_xyz.Vector)
list_length = ListLength(List=merge)
subtraction = Subtraction(A=list_length, B=Slider(1, range=0..1))
number_slider_3 = Slider(4, range=0..10)
construct_domain = ConstructDomain(DomainStart=0, DomainEnd=subtraction)

# ---- group: Loop
fast_loop_start = FastLoopStart(Iterations=Slider(30, range=0..100), Data=point)  # -> port, Counter, Data, Curves

# ----
random = Random(Range=construct_domain, Number=number_slider_3, Seed=fast_loop_start.Counter)  # -> graft(Random)
round = Round(Number=random)  # -> Nearest, Floor, Ceiling
list_item = ListItem(List=merge, Index=round.Nearest, Wrap=True)
move = Move(Geometry=fast_loop_start.Data, Motion=list_item)  # -> Geometry, Transform
line = Line(StartPoint=move.Geometry, EndPoint=fast_loop_start.Data)  # -> flatten(Line)
geometry = Geometry(move.Geometry)

# ---- group: Loop (continued)
fast_loop_end = FastLoopEnd(port=fast_loop_start.port, Exit=False, Data=geometry, Curves=line, RecordData=True, TimeOutVal=0)  # -> Data, Curves

# ----
geometry_2 = Geometry(flatten(fast_loop_end.Data))

# ---- group: For Graft
series = Series(Start=0, Step=1, Count=number_slider_3)
list_length_2 = ListLength(List=geometry_2)
repeat_data = RepeatData(Data=series, Length=list_length_2)
member_index = MemberIndex(Set=repeat_data, Member=series)  # -> simplify(Index), Count
repeat_data_2 = RepeatData(Data=point, Length=number_slider_3)  # -> graft(Data)
list_item_2 = ListItem(List=geometry_2, Index=member_index.Index, Wrap=True)
insert_items = InsertItems(List=list_item_2, Item=repeat_data_2, Indices=0, Wrap=True)

# ----
nurbs_curve = NurbsCurve(Vertices=insert_items, Degree=Slider(3, range=0..10), Periodic=False)  # -> Curve, Length, Domain
panel = Panel(member_index.Index)
pipe = Pipe(Curve=nurbs_curve.Curve, Radius=Slider(0.1, range=0..0.1), Caps=2)
