# Grasshopper definition class.gh (Grasshopper 1.0.7)

boolean_toggle = BooleanToggle(True)
file_path = FilePath("D:\rc18\pointcloud.txt")
readtxtid = CSharpScript(path=file_path, read=boolean_toggle)  # -> out, Points, id, num, debug; inputs path: String, read: Boolean
# ---------- readtxtid: C# usings ----------
using System.IO;
# ---------- readtxtid: C# ----------
    //read file and number of lines
    string[] lines = File.ReadAllLines(path);
    int numlines = lines.Length;

    //declare list of points
    List<Point3d> pts = new List<Point3d>();
    List<int> ids = new List<int>();

    List<double[]> arr = new List<double[]>();
    DataTree<double> myTree = new DataTree<double>();
    List<string> sarr = new List<string>();
    DataTree<string> mySTree = new DataTree<string>();


    //loop through each line
    foreach(string line in lines){
      //separate line into array of strings separated by " "
      string[] parts = line.Split(",".ToCharArray());

      //convert each string to double
      double x = Convert.ToDouble(parts[0]);
      double y = Convert.ToDouble(parts[1]);
      double z = Convert.ToDouble(parts[2]);

      double[] test = {x, y, z};
      arr.Add(test);

      string xs = x.ToString();
      string ys = y.ToString();
      string zs = z.ToString();

      string[] stest = {xs, ys, zs};
      string joined = string.Join(",", stest);
      sarr.Add(joined);

      pts.Add(new Point3d(x, y, z));
    }

    for(int i = 0; i < numlines; i++){
      int lineid = i;
      ids.Add(lineid);
      GH_Path pth = new GH_Path(i);
      double f = arr[i][0];
      double g = arr[i][1];
      double h = arr[i][2];

      myTree.Add(f, pth);
      myTree.Add(g, pth);
      myTree.Add(h, pth);
      myTree.Add(Convert.ToDouble(i), pth);

      string sid = i.ToString();
      sarr.Add(sid);
    }

    Points = pts;
    id = ids;
    num = numlines;


    //debug = arr;
    debug = sarr;
# ---------- end readtxtid ----------
readtxtid_2 = CSharpScript(path=file_path, read=boolean_toggle)  # -> out, Points, id, num, debug; inputs path: String, read: Boolean
# ---------- readtxtid_2: C# ----------
    //read file and number of lines
    string[] lines = File.ReadAllLines(path);
    int numlines = lines.Length;

    //declare list of points
    List<Point3d> pts = new List<Point3d>();
    List<int> ids = new List<int>();

    List<double[]> arr = new List<double[]>();
    //DataTree<double[]> myTree = new DataTree<double[]>();
    DataTree<double> myTree = new DataTree<double>();


    //loop through each line
    foreach(string line in lines){
      //separate line into array of strings separated by " "
      string[] parts = line.Split(",".ToCharArray());

      //convert each string to double
      double x = Convert.ToDouble(parts[0]);
      double y = Convert.ToDouble(parts[1]);
      double z = Convert.ToDouble(parts[2]);

      double[] test = {x, y, z};
      arr.Add(test);
      //GH_Path pth = new GH_Path(line);
      //myTree.Add(test, pth);

      pts.Add(new Point3d(x, y, z));
    }

    for(int i = 0; i < numlines; i++){
      int lineid = i;
      ids.Add(lineid);
      GH_Path pth = new GH_Path(i);
      double f = arr[i][0];
      double g = arr[i][1];
      double h = arr[i][2];

      myTree.Add(f, pth);
      myTree.Add(g, pth);
      myTree.Add(h, pth);
      myTree.Add(Convert.ToDouble(i), pth);
    }

    Points = pts;
    id = ids;
    num = numlines;

    //debug = arr;
    debug = myTree.DataCount;
# ---------- end readtxtid_2 ----------
list_length = ListLength(List=readtxtid_2.Points)
subtraction = Subtraction(A=list_length, B=1)

# ---- group: in progress
file_path_2 = FilePath("D:\rc18\customclass.txt")
readtxtid_3 = CSharpScript(points=readtxtid_2.Points, colour=readtxtid_2.Points, path=file_path_2, save=Button())  # -> out, debug; inputs points: Point3d, colour: Vector3d, path: String, save: Boolean
# ---------- readtxtid_3: C# usings ----------
using System.IO;

class Data{

  //define your own parameters within the data structure
  public string x;
  public string y;
  public string z;
  public string r;
  public string g;
  public string b;
}
# ---------- readtxtid_3: C# ----------
    //declare data
    Data toexport = new Data();

    //declare inputs
    //e.g. declare input points
    Point3d P = new Point3d(points);

    //e.g. declare input colour
    Vector3d Cd = new Vector3d(colour);

    //declare the separator
    string c = ",";

    //assign to data class as strings
    toexport.x = Convert.ToString(P.X);
    toexport.y = Convert.ToString(P.Y);
    toexport.z = Convert.ToString(P.Z);
    toexport.r = Convert.ToString(Cd.Z);
    toexport.g = Convert.ToString(Cd.X);
    toexport.b = Convert.ToString(Cd.Y);

    /*
    //ignore attempt to store ids

    List<int> ids = new List<int>();

    for(int i = 0; i < num; i++){
      ids.Add(i);
    }
    toexport.id = ids.ToString();
    */

    //write each part to a string array
    string[] toexportarr = {toexport.x, toexport.y, toexport.z, toexport.r, toexport.g, toexport.b};
    string data = string.Join(c, toexportarr);

    List<string> dataset = new List<string>();
    dataset.Add(data);

    debug = data;

    //save function
    if(save){
      for(int i = 0; i < data.Count; i++){
        System.IO.File.WriteLine(path, data);
      }
    }
# ---------- end readtxtid_3 ----------
panel = Panel(readtxtid_3.debug)

# ----
c_script = CSharpScript()  # -> out, A, B, C; inputs o: Point3d, branch: Int32, count: Int32, xnum: Double, ynum: Double
# ---------- c_script: C# ----------
    double step = 0.5;

    var xvar = new List<double>();
    var yvar = new List<double>();

    //need a list to hold potential vectors...
    var pot = new List<Vector3d>();

    //need a seed generator...
    var seed = new Random(count);

    //int seed = rnd * count;
    //need amount chosen and a list to hold chosen indeces...
    var selid = new List<int>();
    var sel = new List<Vector3d>();

    for(int i = 0; i < xnum; i++){
      double xpos = step * (i + 1);
      xvar.Add(xpos);
      yvar.Add(xpos);

      double potz = 5;

      double potx = xvar[i];
      double poty = yvar[i];
      Vector3d a = new Vector3d(potx, 0, potz);
      Vector3d b = new Vector3d(0, poty, potz);
      Vector3d c = new Vector3d(-potx, 0, potz);
      Vector3d d = new Vector3d(0, -poty, potz);
      pot.Add(a);
      pot.Add(b);
      pot.Add(c);
      pot.Add(d);
    }

    for(int i = 1; i <= branch; i++){
      int rIndex = seed.Next(pot.Count);
      var item = pot[rIndex];
      sel.Add(item);
      selid.Add(rIndex);
    }

    //int rIndex = seed.Next(pot.Count);

    int potnum = pot.Count;
    //can I add a z value for each vector in my list?

    //foreach(var pots in pot){
    //Vector3d t = new Vector3d(x, y, z);
    //pot.Add(t)
    //for(var i = 0; i < 15; i++){
    //A = xvar + i * test;}
    Vector3d[] array = pot.ToArray();



    //foreach(int selected in pot){}

    A = pot;
    B = sel;
    C = selid;

    String debugvector = seed.ToString();
    //String debug1 = num.ToString();
    //String debug2 = xvar.ToString();
    Print(debugvector);
# ---------- end c_script ----------
randnum = Randnum()  # -> out, rnum, rnumFit; inputs amount: Int32
# ---------- randnum: C# usings ----------
using System.Linq;
# ---------- randnum: C# ----------
    var rand = new Random();
    var randlist = new List<double>();
    var randlistfit = new List<double>();

    double min = domain.T0;
    double max = domain.T1;
    int maxi = Convert.ToInt16(max);

    double fitmin = fit.T0;
    double fitmax = fit.T1;

    for(int i = 0; i < amount; i++){
      double x = rand.Next(maxi);
      double y = fitmin + (fitmax - fitmin) * ((x - min) / (max - min));

      randlist.Add(x);
      randlistfit.Add(y);
    }

    double ave = randlistfit.Average();

    rnum = randlist;
    rnumFit = randlistfit;
    Print("Debug: Average = " + ave.ToString());
# ---------- end randnum ----------
c_script_2 = CSharpScript(amount=Slider(100, range=0..100), domain="0 to 1000", fit="-360 to 360")  # -> out, rnum, rnumFit; inputs amount: Int32; same code as randnum
c_script_3 = CSharpScript()  # -> out, A
# ---------- c_script_3: C# ----------
    DataTree<double> myTree = new DataTree<double>();
    GH_Path pth = new GH_Path();
# ---------- end c_script_3 ----------
readtxtid_4 = CSharpScript(path=file_path, read=boolean_toggle)  # -> out, Points, id, num, debug; inputs path: String, read: Boolean
# ---------- readtxtid_4: C# ----------
    //read file and number of lines
    string[] lines = File.ReadAllLines(path);
    int numlines = lines.Length;

    //declare list of points
    List<Point3d> pts = new List<Point3d>();
    List<int> ids = new List<int>();

    List <double[]> towrite = new List<double[]>();
    double[] test = {0,1,2,3,4,5};

    //loop through each line
    foreach(string line in lines){
      //separate line into array of strings separated by " "
      string[] parts = line.Split(",".ToCharArray());

      //convert each string to double
      double x = Convert.ToDouble(parts[0]);
      double y = Convert.ToDouble(parts[1]);
      double z = Convert.ToDouble(parts[2]);

      pts.Add(new Point3d(x, y, z));

      //array to store the point
      //string[] position = {parts[0], parts[1], parts[2]};
      //towrite.Add(parts);
    }

    for(int i = 0; i < numlines; i++){
      int lineid = i;
      ids.Add(lineid);
    }

    Points = pts;
    id = ids;
    num = numlines;
    debug = test;
    Print(debug.ToString());
# ---------- end readtxtid_4 ----------
readtxt = CSharpScript(path=file_path, read=boolean_toggle)  # -> out, Points; inputs path: String, read: Boolean
# ---------- readtxt: C# ----------
    //read file
    string[] lines = File.ReadAllLines(path);

    //declare list of points
    List<Point3d> pts = new List<Point3d>();

    //loop through each line
    foreach(string line in lines){
      //separate line into array of strings separated by " "
      string[] parts = line.Split(",".ToCharArray());

      //convert each string to double
      double x = Convert.ToDouble(parts[0]);
      double y = Convert.ToDouble(parts[1]);
      double z = Convert.ToDouble(parts[2]);

      pts.Add(new Point3d(x, y, z));
    }

    Points = pts;
# ---------- end readtxt ----------
readtxtid_5 = CSharpScript(path=file_path, read=boolean_toggle)  # -> out, Points, id, num; inputs path: String, read: Boolean
# ---------- readtxtid_5: C# ----------
    //read file and number of lines
    string[] lines = File.ReadAllLines(path);
    int numlines = lines.Length;

    //declare list of points
    List<Point3d> pts = new List<Point3d>();
    List<int> ids = new List<int>();

    //loop through each line
    foreach(string line in lines){
      //separate line into array of strings separated by " "
      string[] parts = line.Split(",".ToCharArray());

      //convert each string to double
      double x = Convert.ToDouble(parts[0]);
      double y = Convert.ToDouble(parts[1]);
      double z = Convert.ToDouble(parts[2]);

      pts.Add(new Point3d(x, y, z));
    }

    for(int i = 0; i < numlines; i++){
      int lineid = i;
      ids.Add(lineid);
    }

    Points = pts;
    id = ids;
    num = numlines;
# ---------- end readtxtid_5 ----------
file_path_3 = FilePath("C:\Users\MYSHKIN\Desktop\New Text Document.txt")
readtxtid_6 = CSharpScript(points=readtxtid_2.Points, colour=readtxtid_2.Points)  # -> out, debug; inputs points: Point3d, colour: Vector3d
# ---------- readtxtid_6: C# ----------
    //declare data
    Data toexport = new Data();

    //declare inputs
    //e.g. declare input points
    Point3d P = new Point3d(points);

    //e.g. declare input colour
    Vector3d Cd = new Vector3d(colour);

    //declare the separator
    string c = ",";

    //assign to data class as strings
    toexport.x = Convert.ToString(P.X);
    toexport.y = Convert.ToString(P.Y);
    toexport.z = Convert.ToString(P.Z);
    toexport.r = Convert.ToString(Cd.Z);
    toexport.g = Convert.ToString(Cd.X);
    toexport.b = Convert.ToString(Cd.Y);

    //write each part to a string array
    string[] toexportarr = {toexport.x, toexport.y, toexport.z, toexport.r, toexport.g, toexport.b};
    string data = string.Join(c, toexportarr);

    debug = data;
# ---------- end readtxtid_6 ----------
point = Point(Point(0, 0, 0))
value_list = ValueList({"One": 1, "Two": 2, "Three": 2² - 1, "Four": Sqrt(16)}, selected="One")
import_coordinates = ImportCoordinates(
    File=file_path_3,
    Separator=" ",
    XIndex=Slider(3, range=0..10),
    YIndex=Slider(2, range=0..10),
    ZIndex=Slider(1, range=0..1))
read_file = ReadFile(File=file_path_3, PerLineParse=True)  # -> graft(Content)
text_join = TextJoin(Text=readtxtid_2.debug, Join=",")
c_script_4 = CSharpScript(e=Slider(1, range=0..1), h=Slider(2, range=0..10))  # -> out, A, B; inputs e: Double, h: Int32
# ---------- c_script_4: C# usings ----------
struct DataPnt
{
  public double x;
  public double y;
  public double z;
  public int r;
  public int g;
  public int b;
  //private double i;
}
# ---------- c_script_4: C# ----------
    var PntList = new List<double>();
    var CdList = new List<int>();

    DataPnt DataPoint = new DataPnt();
    DataPoint.x = e;
    DataPoint.y = e;
    DataPoint.z = e;
    DataPoint.r = h;
    DataPoint.g = h;
    DataPoint.b = h;

    System.Drawing.Color test = System.Drawing.Color.FromArgb(DataPoint.r, DataPoint.g, DataPoint.b);

    PntList.Add(DataPoint.x);
    PntList.Add(DataPoint.y);
    PntList.Add(DataPoint.z);


    /*
    y = e;
    z = e;
    r = e;
    g = e;
    b = e;
    i = e;
    */
    double[] array = {DataPoint.x, DataPoint.y, DataPoint.z, DataPoint.r, DataPoint.g, DataPoint.b};

    A = PntList;
    B = test;
# ---------- end c_script_4 ----------
panel_2 = Panel("""True
True
True
False
False
False""")
panel_3 = Panel(readtxt.Points)
panel_4 = Panel(readtxtid_5.id)
panel_5 = Panel(readtxtid_6.debug)
panel_6 = Panel(c_script_2.rnumFit)
panel_7 = Panel(c_script_2.out)
data = Data(read_file)
number_slider = Slider(1, range=0..10)
vector = Vector(read_file)
geometry = Geometry(read_file)
panel_8 = Panel(readtxtid_2.Points)
domain = Domain(data)
pick_n_choose = PickNChoose(Pattern=[0, 1])
panel_9 = Panel(c_script_4.B)
dispatch = Dispatch(List=read_file, DispatchPattern=panel_2)  # -> ListA, ListB
c_script_5 = CSharpScript()  # -> out, potVec, selVec, selVec_id; inputs data: Point3d, branch: Int32, count: Int32, xnum: Double, ynum: Double
# ---------- c_script_5: C# ----------
    double step = 0.5;

    var xvar = new List<double>();
    var yvar = new List<double>();

    //need a list to hold potential vectors...
    var pot = new List<Vector3d>();

    //need a seed generator...
    var seed = new Random(count);

    //int seed = rnd * count;
    //need amount chosen and a list to hold chosen indeces...
    var selid = new List<int>();
    var sel = new List<Vector3d>();

    for(int i = 0; i < xnum; i++){
      double xpos = step * (i + 1);
      xvar.Add(xpos);
      yvar.Add(xpos);

      double potz = 5;

      double potx = xvar[i];
      double poty = yvar[i];
      Vector3d a = new Vector3d(potx, 0, potz);
      Vector3d b = new Vector3d(0, poty, potz);
      Vector3d c = new Vector3d(-potx, 0, potz);
      Vector3d d = new Vector3d(0, -poty, potz);
      pot.Add(a);
      pot.Add(b);
      pot.Add(c);
      pot.Add(d);
    }

    for(int i = 1; i <= branch; i++){
      int rIndex = seed.Next(pot.Count);
      var item = pot[rIndex];
      sel.Add(item);
      selid.Add(rIndex);
    }

    //int rIndex = seed.Next(pot.Count);

    int potnum = pot.Count;
    //can I add a z value for each vector in my list?

    //foreach(var pots in pot){
    //Vector3d t = new Vector3d(x, y, z);
    //pot.Add(t)
    //for(var i = 0; i < 15; i++){
    //A = xvar + i * test;}
    Vector3d[] array = pot.ToArray();



    //foreach(int selected in pot){}

    potVec = pot;
    selVec = sel;
    selVec_id = selid;

    String debugvector = seed.ToString();
    //String debug1 = num.ToString();
    //String debug2 = xvar.ToString();
    Print(debugvector);
# ---------- end c_script_5 ----------
merge = Merge(Data1=c_script_4.A, Data2=c_script_4.B)  # -> flatten(Result)
sub_list = SubList(List=read_file, Wrap=True)  # -> List, Index
point_2 = Point(import_coordinates)
param_viewer = ParamViewer(readtxtid_2.debug)
characters = Characters()  # -> Result, Unicode
panel_10 = Panel(merge)
text_split = TextSplit(Text=read_file)
format = Format(Culture=127)
radians = Radians(Degrees=c_script_2.rnumFit)
panel_11 = Panel(text_split)
point_3 = Point(Point(1, 1, 1))
point_4 = Point(Point(0, 0, 1))
rotate = Rotate(Vector=point_3, Axis=point_4, Angle=radians)
point_5 = Point(Point(0, 0, 0))
multiplication = Multiplication(A=rotate, B=c_script_2.rnumFit)
line = Line(StartPoint=point_5, EndPoint=multiplication)
angle = Angle()  # -> Angle, Reflex
end_points = EndPoints(Curve=line)  # -> Start, End
sort_list = SortList(Keys=c_script_2.rnumFit, ValuesA=end_points.End)  # -> Keys, ValuesA
nurbs_curve = NurbsCurve(Vertices=sort_list.ValuesA, Degree=Slider(3, range=1..3), Periodic=False)  # -> Curve, Length, Domain
polyline = PolyLine(Vertices=sort_list.ValuesA, Closed=False)
panel_12 = Panel(end_points.End)
