# Grasshopper definition colonisation_01.gh (Grasshopper 1.0.7)
# plug-ins: Anemone

number_slider = Slider(25, range=0..25)

# ----
# Feed me!
geometry = Geometry(<brep referenced from the Rhino model>)

populate_3d = Populate3D(Region=geometry, Count=Slider(4500, range=0..5000), Seed=1)
populate_geometry = PopulateGeometry(Geometry=geometry, Count=number_slider, Seed=1)
populate_geometry_2 = PopulateGeometry(Geometry=geometry, Count=Slider(1000, range=0..2000), Seed=1)
point_in_brep = PointInBrep(Brep=geometry, Point=populate_3d, Strict=False)
cull_pattern = CullPattern(List=populate_3d, CullPattern=point_in_brep)
merge = Merge(Data1=populate_geometry_2, Data2=cull_pattern)
find_similar_member = FindSimilarMember(Data=populate_geometry, Set=merge)  # -> Hit, Index
cull_index = CullIndex(List=merge, Indices=find_similar_member.Index, Wrap=True)
population = Geometry(cull_index)
list_length = ListLength(List=population)
panel = Panel(list_length)
rad = Slider(3, range=0..10)

# ---- group: Option 02
point = Point(<point referenced from the Rhino model>)

# ---- group: Option 01
point_2 = Point(populate_geometry)
series = Series(Start=0, Step=1, Count=number_slider)
number_slider_2 = Slider(1, range=0..1)

# ----
seeds = Geometry(point_2)

fast_loop_start = FastLoopStart(Iterations=Slider(5, range=0..100), Population=population, Seeds=seeds)  # -> port, Counter, Population, Seeds

closest_points = ClosestPoints(Point=fast_loop_start.Seeds, Cloud=fast_loop_start.Population, Count=3)  # -> ClosestPoint, CPIndex, Distance
point_3 = Point(graft(fast_loop_start.Seeds))
list_item = ListItem(List=fast_loop_start.Population, Index=closest_points.CPIndex, Wrap=True)
subtraction = Subtraction(A=list_item, B=point_3)
average = Average(Input=subtraction)
unit_vector = UnitVector(Vector=average)
multiplication = Multiplication(A=unit_vector, B=rad)
unit_vector_2 = UnitVector(Vector=point_3)
point_4 = Point(fast_loop_start.Population)
addition = Addition(A=multiplication, B=point_3)

# ---- group: ignore
subtraction_2 = Subtraction(A=list_item, B=point_3)
vector_length = VectorLength(Vector=subtraction_2)
average_2 = Average(Input=vector_length)
larger_than = LargerThan(FirstNumber=average_2, SecondNumber=Slider(5, range=0..10))  # -> LargerThan, OrEqualTo
cull_pattern_2 = CullPattern(List=point_3, CullPattern=larger_than.LargerThan)  # -> flatten(List)
merge_2 = Merge(Data1=flatten(addition), Data2=cull_pattern_2)  # -> graft(Result)

# ----
subtraction_3 = Subtraction(A=unit_vector, B=unit_vector_2)
merge_3 = Merge(Data1=addition, Data2=point_3)
equality = Equality(FirstNumber=subtraction_3, SecondNumber="0,0,0")  # -> Equality, Inequality
cull_pattern_3 = CullPattern(List=addition, CullPattern=equality.Inequality)
find_similar_member_2 = FindSimilarMember(Data=flatten(merge_3), Set=point_4)  # -> Hit, Index
panel_2 = Panel(equality.Inequality)
cull_index_2 = CullIndex(List=point_4, Indices=find_similar_member_2.Index, Wrap=True)

fast_loop_end = FastLoopEnd(
    port=fast_loop_start.port,
    Exit=False,
    Population=cull_index_2,
    Seeds=flatten(cull_pattern_3),
    RecordData=True,
    TimeOutVal=0)  # -> Population, Seeds

geometry_2 = Geometry(fast_loop_end.Population)
geometry_3 = Geometry(simplify(flatten(fast_loop_end.Seeds)))

# ---- group: Option 01 (continued)
list_length_2 = ListLength(List=geometry_3)
repeat_data = RepeatData(Data=series, Length=list_length_2)
member_index = MemberIndex(Set=repeat_data, Member=series)  # -> simplify(Index), Count
list_item_2 = ListItem(List=geometry_3, Index=member_index.Index, Wrap=True)
nurbs_curve = NurbsCurve(Vertices=list_item_2, Degree=2, Periodic=False)  # -> Curve, Length, Domain
pipe = Pipe(Curve=nurbs_curve.Curve, Radius=Slider(1, range=0..10), Caps=2)

# ---- group: Option 02 (continued)
nurbs_curve_2 = NurbsCurve(Vertices=geometry_3, Degree=2, Periodic=False)  # -> Curve, Length, Domain

# ----
list_length_3 = ListLength(List=geometry_3)
sort_list = SortList(Keys=flatten(nurbs_curve.Length), ValuesValuesA=flatten(nurbs_curve.Curve))  # -> Keys, ValuesValuesA
curve_curve = CurveCurve(CurveA=sort_list.ValuesValuesA, CurveB=sort_list.ValuesValuesA)  # -> Points, ParamsA, ParamsB
panel_3 = Panel(curve_curve.Points)
