# Grasshopper definition crv_normal.gh (Grasshopper 1.0.7)

division = Division(A="1", B=Slider(0.05, range=0..0.1))
curve = Curve(reparameterize(<curve referenced from the Rhino model>))
divide_curve = DivideCurve(Curve=curve, Count=division, Kinks=False)  # -> Points, Tangents, Parameters
up = Point(Point(0, 0, 1))
cross_product = CrossProduct(VectorA=up, VectorB=divide_curve.Tangents, Unitize=False)  # -> Vector, Length

# ---- group: flip Normal w.Switch
negative = Negative(Value=cross_product.Vector)
stream_filter = StreamFilter(Gate=Slider(1, range=0..1), Stream0=cross_product.Vector, Stream1=negative)

# ---- group: visualise Normal
line_sdl = LineSDL(Start=divide_curve.Points, Direction=stream_filter, Length=Slider(5, range=0..10))
