# Grasshopper definition nearpoints_01.gh (Grasshopper 1.0.7)

# ---- group: Grid Cloud
add_an_origin_point = Point(<point referenced from the Rhino model>)
number_slider = Slider(2, range=0..10)
number_slider_2 = Slider(20, range=0..50)
center_box = CenterBox(Base=add_an_origin_point, X=number_slider, Y=number_slider, Z=number_slider)
box_array = BoxArray(Geometry=add_an_origin_point, Cell=center_box, XCount=number_slider_2, YCount=number_slider_2, ZCount=number_slider_2)  # -> Geometry, Transform
average = Average(Input=box_array.Geometry)
negative = Negative(Value=average)
deconstruct = Deconstruct(Point=negative)  # -> XComponent, YComponent, ZComponent
panel = Panel(average)
vector_xyz = VectorXYZ(XComponent=deconstruct.XComponent, YComponent=deconstruct.YComponent, ZComponent=0)  # -> Vector, Length
move = Move(Geometry=box_array.Geometry, Motion=vector_xyz.Vector)  # -> Geometry, Transform

# ---- group: Input Curve
geometry = Geometry(<curve referenced from the Rhino model>)

# ----
bounding_box = BoundingBox(Content=geometry, Plane=PlaneXY(0, 0, 0))  # -> Box, Box_2
number_slider_3 = Slider(10, range=0..10)
area = Area(Geometry=bounding_box.Box)  # -> Area, Centroid
scale_nu = ScaleNU(Geometry=bounding_box.Box, Plane=area.Centroid, ScaleX=number_slider_3, ScaleY=number_slider_3, ScaleZ=1)  # -> Geometry, Transform
number_slider_4 = Slider(500, range=0..1000)
populate_geometry = PopulateGeometry(Geometry=scale_nu.Geometry, Count=number_slider_4, Seed=1)
populate_3d = Populate3D(Region=scale_nu.Geometry, Count=number_slider_4, Seed=1)
control_points = ControlPoints(Curve=geometry)  # -> Points, Weights, Knots
number_slider_5 = Slider(7, range=0..25)

# ---- group: CLOUD Variations
cloud_03 = Geometry(move.Geometry)
cloud_02 = Geometry(populate_geometry)
cloud_01 = Geometry(populate_3d)

# ----
input_cloud = Point(cloud_03)
pts = Point(control_points.Points)

# ---- group: IGNORE - nearpoints
distance = Distance(PointA=graft(pts), PointB=input_cloud)
sort_list = SortList(Keys=distance, ValuesValuesA=input_cloud)  # -> Keys, ValuesValuesA
larger_than = LargerThan(FirstNumber=number_slider_5, SecondNumber=sort_list.Keys)  # -> LargerThan, OrEqualTo
cull_pattern = CullPattern(List=sort_list.ValuesValuesA, CullPattern=larger_than.LargerThan)  # -> simplify(List)

# ----
construct_domain = ConstructDomain(DomainStart=0, DomainEnd=Slider(3, range=0..10))

# ---- group: UserObject
nearpoints = Nearpoints(points=pts, cloud=input_cloud, radius=number_slider_5)  # -> nearpts, dist

# ----
sub_list = SubList(List=sort_list.ValuesValuesA, Domain=construct_domain, Wrap=True)  # -> simplify(List), Index

# ---- group: BASIC
line = Line(StartPoint=graft(pts), EndPoint=nearpoints.nearpts)
line_2 = Line(StartPoint=graft(pts), EndPoint=sub_list.List)

# ----
shift_list = ShiftList(List=flatten(pts), Shift=1, Wrap=True)
list_length = ListLength(List=shift_list)
cull_nth = CullNth(List=shift_list, CullFrequency=list_length)

# ---- group: In the case of points not having neighbours because of the radius limitation...
clean_tree = CleanTree(RemoveNulls=True, RemoveInvalid=True, RemoveEmpty=True, Tree=nearpoints.nearpts)
tree_statistics = TreeStatistics(Tree=clean_tree)  # -> Paths, Length, Count
characters = Characters(Text=tree_statistics.Paths)  # -> Result, Unicode
panel_2 = Panel("""0
-1""")
cull_index = CullIndex(List=characters.Result, Indices=panel_2, Wrap=True)
text_join = TextJoin(Text=cull_index)  # -> flatten(Result)
list_length_2 = ListLength(List=text_join)
subtraction = Subtraction(A=list_length_2, B=1)
cull_index_2 = CullIndex(List=text_join, Indices=subtraction, Wrap=True)
list_item = ListItem(List=cull_nth, Index=cull_index_2, Wrap=True)

# ----
point = Point(pts)
insert_items = InsertItems(List=sub_list.List, Item=graft(cull_nth), Indices="0", Wrap=True)
insert_items_2 = InsertItems(List=clean_tree, Item=graft(list_item), Indices="0", Wrap=True)
list_item_2 = ListItem(List=point, Index=text_join, Wrap=True)

# ---- group: VERSION w. Input Curve
line_3 = Line(StartPoint=graft(list_item_2), EndPoint=insert_items_2)  # -> simplify(Line)
line_4 = Line(StartPoint=graft(pts), EndPoint=insert_items)  # -> simplify(Line)

# ----
curve = Curve(line_3)
cull_index_3 = CullIndex(List=curve, Indices=0, Wrap=True)
list_item_3 = ListItem(List=curve, Index=0, Wrap=True)
geometry_2 = Geometry(flatten(list_item_3))
perp_frames = PerpFrames(Curve=curve, Count=Slider(2, range=0..10), Align=True)  # -> Frames, Parameters
curve_2 = Curve(flatten(cull_index_3))
join_curves = JoinCurves(Curves=geometry_2, Preserve=False)
curve_3 = Curve(graft(curve_2))
panel_3 = Panel("""0.1
0.2
0.5""")

# ---- group: Play
pipe = Pipe(Curve=join_curves, Radius=Slider(0.5, range=0..1), Caps=2)  # disabled
pipe_variable = PipeVariable(Curve=curve_3, Parameters=perp_frames.Parameters, Radii=panel_3, Caps=2)  # -> flatten(Pipe); disabled
sphere = Sphere(Base=perp_frames.Frames, Radius=Slider(0.2, range=0..1))  # disabled

# ==== cluster Nearpoints: Finds the near points within a given radius.
cloud = ClusterInput()  # Cloud to search in.
points = ClusterInput()  # Points to search from.
distance = Distance(PointA=graft(points), PointB=cloud)
sort_list = SortList(Keys=distance, ValuesValuesA=cloud)  # -> Keys, ValuesValuesA
radius = ClusterInput()  # Search radius.
larger_than = LargerThan(FirstNumber=radius, SecondNumber=sort_list.Keys)  # -> LargerThan, OrEqualTo
cull_pattern = CullPattern(List=sort_list.ValuesValuesA, CullPattern=larger_than.LargerThan)  # -> simplify(List)
nearpts = ClusterOutput(cull_pattern)  # Near points.
dist = ClusterOutput(distance)  # Point to cloud distances.
