# Grasshopper definition parts_aggregation_01.gh (Grasshopper 1.0.7)
# plug-ins: Anemone

point = Point([<point referenced from the Rhino model> x2])
point_2 = Point([<point referenced from the Rhino model> x2])
point_3 = Point([<point referenced from the Rhino model> x4])
point_4 = Point([<point referenced from the Rhino model> x5])
point_5 = Point([<point referenced from the Rhino model> x4])
point_6 = Point([<point referenced from the Rhino model> x5])

# ---- group: Aggregate Types
A = Point(point)
B = Point(point_2)
C = Point(point_3)
D = Point(point_4)
E = Point(point_5)
F = Point(point_6)

# ----
iterations = Slider(50, range=0..200)
seed = Slider(4, range=0..25)
tree_of_types = Entwine(Branch00=A, Branch01=B, Branch02=C, Branch03=D, Branch04=E, Branch05=F, FlattenInputs=True)
point_7 = Point(Point(0, 0, 0))
fast_loop_start = FastLoopStart(Iterations=iterations, Seed=seed, Origin=point_7, Choice=tree_of_types, Aggregate=point_7)  # -> port, Counter, Data, Origin, Choice, Aggregate
aggregate = Geometry(fast_loop_start.Aggregate)
seed_2 = Number(fast_loop_start.Data)
origin = Geometry(fast_loop_start.Origin)
counter = Number(fast_loop_start.Counter)
loop_start = LoopStart(Repeat=0, Trigger=Toggle(True))  # -> port, Counter, Origin, Choice, Aggregate
multiplication = Multiplication(A=counter, B=seed_2)

# ---- group: Choice of Aggregate
split_tree = SplitTree(Data=fast_loop_start.Choice, Masks=flatten("{0;*}"))  # -> Positive, Negative
tree_statistics = TreeStatistics(Tree=split_tree.Positive)  # -> Paths, Length, Count
subtraction = Subtraction(A=tree_statistics.Count, B=1)
construct_domain = ConstructDomain(DomainStart=0, DomainEnd=subtraction)
random = Random(Range=construct_domain, Number=1, Seed=multiplication)
geometry = Geometry(split_tree.Positive)
round = Round(Number=random)  # -> Nearest, Floor, Ceiling
replace_text = ReplaceText(Text="{0;x}", Find="x", Replace=round.Nearest, RecursiveReplace=False)
tree_branch = TreeBranch(Tree=geometry, Path=replace_text, MaintainPaths=True)
debug = Panel(replace_text)

# ----
loop_end = LoopEnd(Exit=False, TimeOutVal=0, pausedState=False, state="Constant & Record")  # -> Origin, Choice, simplify(Aggregate)

# ----
# index for the last item in a list is
# 
# -1
geometry_2 = Geometry()
list_length = ListLength(List=geometry_2)
subtraction_2 = Subtraction(A=list_length, B="1")
last_item_in_the_list = ListItem(List=geometry_2, Index=0, Wrap=True)

# ---- group: Potential Axes
merge = Merge(Data1="1,0,0", Data2="0,1,0", Data3="0,0,1", Data4="-1,0,0", Data5="0,-1,0", Data6="0,0,-1")
list_length_2 = ListLength(List=merge)
randitem = Randitem(list=merge, valnum=list_length_2, seed=multiplication)  # -> debugid, i

# ----
addition = Addition(A=multiplication, B=2)

# ---- group: Potential Rotations
number_slider = Slider(8, range=0..10)
negative = Negative(Value="2*Pi")
division = Division(A="2*Pi", B=number_slider)
multiplication_2 = Multiplication(A=number_slider, B=2)
addition_2 = Addition(A=multiplication_2, B=1)
series = Series(Start=negative, Step=division, Count=addition_2)
randitem_2 = Randitem(list=series, valnum=addition_2, seed=addition)  # -> debugid, i

# ---- group: Future Origin Selection
addition_3 = Addition(A=multiplication, B=3)
aggregate_2 = Geometry(aggregate)
list_length_3 = ListLength(List=aggregate_2)
randitem_3 = Randitem(list=aggregate_2, valnum=list_length_3, seed=addition_3)  # -> debugid, i

# ---- group: Transformation
origin_2 = Geometry(origin)
move = Move(Geometry=tree_branch, Motion=graft(origin_2))  # -> Geometry, Transform
rotate_3d = Rotate3D(Geometry=move.Geometry, Angle=randitem_2.i, Center=origin_2, Axis=randitem.i)  # -> Geometry, Transform

# ----
panel = Panel(series)
fast_loop_end = FastLoopEnd(
    port=fast_loop_start.port,
    Exit=False,
    Data=seed_2,
    Origin=randitem_3.i,
    Choice=split_tree.Positive,
    Aggregate=rotate_3d.Geometry,
    RecordData=True,
    TimeOutVal=0)  # -> Seed, Origin, Choice, simplify(Aggregate)
split_tree_2 = SplitTree(Data=fast_loop_end.Choice, Masks=flatten("{0;*}"))  # -> Positive, Negative
geometry_3 = Geometry(fast_loop_end.Aggregate)
geometry_4 = Geometry(fast_loop_end.Origin)
list_length_4 = ListLength(List=flatten(geometry_4))  # -> flatten(Length)
tree_statistics_2 = TreeStatistics(Tree=split_tree_2.Positive)  # -> Paths, Length, Count
cull_duplicates = CullDuplicates(Points=flatten(geometry_3), Tolerance=0.1, CullMode=3)  # -> Points, Indices, Valence
division_2 = Division(A=Slider(1, range=0..1), B=2)
point_8 = Point(Point(0, 0, 0))
panel_2 = Panel(tree_statistics_2.Count)
panel_3 = Panel(list_length_4)
sphere = Sphere(Base=point_8, Radius=division_2)
center_box = CenterBox(Base=point_8, X=division_2, Y=division_2, Z=division_2)
bounds = Bounds(Numbers=cull_duplicates.Valence)
move_2 = Move(Geometry=sphere, Motion=flatten(cull_duplicates.Points))  # -> Geometry, Transform
move_3 = Move(Geometry=center_box, Motion=flatten(cull_duplicates.Points))  # -> Geometry, Transform
remap_numbers = RemapNumbers(Value=cull_duplicates.Valence, Source=bounds, Target="0.25 to 1")  # -> Mapped, Clipped

# ---- group: you can ignore
point_9 = Point(geometry_3)
polyline = PolyLine(Vertices=point_9, Closed=False)
nurbs_curve = NurbsCurve(Vertices=point_9, Degree=Slider(1, range=0..10), Periodic=False)  # -> Curve, Length, Domain
smooth_polyline = SmoothPolyline(Polyline=polyline, Strength=Slider(1, range=0..1), Times=Slider(1, range=0..10))
pipe = Pipe(Curve=nurbs_curve.Curve, Radius=Slider(0.1, range=0..1), Caps=1)
merge_2 = Merge(Data1=flatten(pipe))

# ----
scale = Scale(Geometry=move_2.Geometry, Center=cull_duplicates.Points, Factor=remap_numbers.Mapped)  # -> Geometry, Transform
geometry_5 = Geometry(scale.Geometry)
panel_4 = Panel(merge_2)

# ==== cluster Randitem: Outputs a random item from a list.
valnum = ClusterInput()  # Number of Values
subtraction = Subtraction(A=valnum, B=1)
list = ClusterInput()
seed = ClusterInput()
construct_domain = ConstructDomain(DomainStart=0, DomainEnd=subtraction)
random = Random(Range=construct_domain, Number=1, Seed=seed)
round = Round(Number=random)  # -> Nearest, Floor, Ceiling
list_item = ListItem(List=list, Index=round.Nearest, Wrap=True)
debugid = ClusterOutput(round.Nearest)  # debug index
i = ClusterOutput(list_item)
