# Grasshopper definition pixelfarming_probability.gh (Grasshopper 1.0.7)
# plug-ins: Anemone

size_x = Slider(25, range=0..100)
size_y = Slider(25, range=0..100)
square = Square(Plane=PlaneXY(0, 0, 0), Size=1, ExtentX=size_x, ExtentY=size_y)  # -> Cells, Points
# Input Percentages of A,B,C,D
panel = Panel("""0.13
0.27
0.38
0.22""")
list_length = ListLength(List=flatten(square.Cells))
random = Random(Range=Domain(0, 1), Number=list_length, Seed=2)
multiplication = Multiplication(A=list_length, B=panel)
sort_list = SortList(Keys=random, ValuesValuesA=flatten(square.Cells))  # -> Keys, ValuesValuesA
panel_2 = Panel(multiplication)
partition_list = PartitionList(List=flatten(sort_list.ValuesValuesA), Size=multiplication)  # -> simplify(Chunks)
boundary_surfaces = BoundarySurfaces(Edges=partition_list)
fora = Panel("""0.7
0.2
0.1""")
panel_3 = Panel(partition_list)
explode_tree = ExplodeTree(Data=boundary_surfaces)  # -> Branch0, Branch1, Branch2, Branch3
fora_2 = Panel("""B
C
D""")
geometry = Geometry(flatten(partition_list))
multiplication_2 = Multiplication(A=fora, B=Slider(10, range=0..10))  # -> graft(Result)
forb = Panel("""A
C
D""")
forc = Panel("""A
B
D""")
ford = Panel("""A
B
C""")
duplicate_data = DuplicateData(Data=graft(fora_2), Number=multiplication_2, Order=True)  # -> flatten(Data)
custom_preview = CustomPreview(Geometry=explode_tree.Branch0, Material=ColourSwatch(SwatchColor=RGB(255, 0, 0)))
custom_preview_2 = CustomPreview(Geometry=explode_tree.Branch1, Material=ColourSwatch(SwatchColor=RGB(0, 17, 255)))
custom_preview_3 = CustomPreview(Geometry=explode_tree.Branch2, Material=ColourSwatch(SwatchColor=RGB(255, 238, 0)))
custom_preview_4 = CustomPreview(Geometry=explode_tree.Branch3, Material=ColourSwatch(SwatchColor=RGB(21, 255, 0)))
list_length_2 = ListLength(List=duplicate_data)
fast_loop_start = FastLoopStart(Iterations=Slider(3, range=0..10), Data=partition_list)  # -> port, Counter, Data
explode_tree_2 = ExplodeTree(Data=fast_loop_start.Data)  # -> Branch0, Branch1, Branch2, Branch3
panel_4 = Panel(explode_tree_2.Branch0)
randlist = Randlist(list=explode_tree_2.Branch1)
randlist_2 = Randlist(list=explode_tree_2.Branch3)
randlist_3 = Randlist(list=explode_tree_2.Branch0)
item_index = ItemIndex(List=randlist_3, Item=randlist_3)
randlist_4 = Randlist(list=explode_tree_2.Branch2)
randitem = Randitem(list=flatten(duplicate_data), valnum=list_length_2, seed=item_index)  # -> debugid, flatten(i)
cluster = Cluster(members=fora_2, randlist=randlist_3, original=explode_tree_2.Branch0)  # -> _0, _1, _2
list_length_3 = ListLength(List=randlist_3)
member_index = MemberIndex(Set=randitem.i, Member=fora_2)  # -> Index, Count
multiplication_3 = Multiplication(A=list_length_3, B=fora)
list_item = ListItem(List=explode_tree_2.Branch0, Index=member_index.Index, Wrap=True)  # -> simplify(Item)
cluster_2 = Cluster(members=forb, randlist=randlist, original=explode_tree_2.Branch1)  # -> _0, _1, _2
cluster_3 = Cluster(members=forc, randlist=randlist_4, original=explode_tree_2.Branch2)  # -> _0, _1, _2
cluster_4 = Cluster(members=ford, randlist=randlist_2, original=explode_tree_2.Branch3)  # -> _0, _1, _2
panel_5 = Panel(multiplication_3)
panel_6 = Panel(member_index.Count)
explode_tree_3 = ExplodeTree(Data=list_item)  # -> Branch0, Branch1, Branch2
_0 = _0(explode_tree_3.Branch0)  # {0}
_1 = _1(explode_tree_3.Branch1)  # {1}
_2 = _2(explode_tree_3.Branch2)  # {2}
panel_7 = Panel(randlist_3)
panel_8 = Panel(list_item)
A = Merge(Data1=cluster_2._0, Data2=cluster_3._0, Data3=cluster_4._0)  # -> flatten(Result)

# ---- group: B
A_2 = Merge(Data1=cluster._0, Data2=cluster_3._1, Data3=cluster_4._1)  # -> flatten(Result)

# ---- group: C
A_3 = Merge(Data1=cluster._1, Data2=cluster_2._1, Data3=cluster_4._2)  # -> flatten(Result)

# ---- group: D
A_4 = Merge(Data1=cluster._2, Data2=cluster_2._2, Data3=cluster_3._2)  # -> flatten(Result)

# ----
entwine = Entwine(Branch00=A, Branch01=A_2, Branch02=A_3, Branch03=A_4, FlattenInputs=True)
geometry_2 = Geometry(entwine)
fast_loop_end = FastLoopEnd(port=fast_loop_start.port, Exit=False, Data=geometry_2, RecordData=False, TimeOutVal=0)
boundary_surfaces_2 = BoundarySurfaces(Edges=fast_loop_end)
mesh = Mesh(boundary_surfaces_2)
explode_tree_4 = ExplodeTree(Data=simplify(mesh))  # -> Branch0, Branch1, Branch2, Branch3
custom_preview_5 = CustomPreview(Geometry=explode_tree_4.Branch0, Material=ColourSwatch(SwatchColor=RGB(255, 0, 0)))
custom_preview_6 = CustomPreview(Geometry=explode_tree_4.Branch1, Material=ColourSwatch(SwatchColor=RGB(0, 17, 255)))
custom_preview_7 = CustomPreview(Geometry=explode_tree_4.Branch2, Material=ColourSwatch(SwatchColor=RGB(255, 238, 0)))
custom_preview_8 = CustomPreview(Geometry=explode_tree_4.Branch3, Material=ColourSwatch(SwatchColor=RGB(21, 255, 0)))

# ==== cluster Randlist: Sorts a list in random order.
list = ClusterInput()  # Input list...
list_length = ListLength(List=flatten(list))
random = Random(Range=Domain(0, 1), Number=list_length, Seed=2)
sort_list = SortList(Keys=random, ValuesValuesA=flatten(list))  # -> Keys, ValuesValuesA
random_list = ClusterOutput(sort_list.ValuesValuesA)  # Randomly sorted list...

# ==== cluster Cluster
randlist = ClusterInput()  # List of Randomised Plots...
members = ClusterInput()  # List of Members...
item_index = ItemIndex(List=randlist, Item=randlist)
list_length = ListLength(List=members)
randitem = Randitem(list=flatten(members), valnum=list_length, seed=item_index)  # -> debugid, flatten(i)
panel = Panel(item_index)
original = ClusterInput()  # Original List of Plots...
member_index = MemberIndex(Set=randitem.i, Member=members)  # -> Index, Count
list_item = ListItem(List=original, Index=member_index.Index, Wrap=True)  # -> simplify(Item)
explode_tree = ExplodeTree(Data=list_item)  # -> Branch0, Branch1, Branch2
panel_2 = Panel(list_item)
_0 = ClusterOutput(explode_tree.Branch0)  # {0}
_1 = ClusterOutput(explode_tree.Branch1)  # {1}
_2 = ClusterOutput(explode_tree.Branch2)  # {2}

# ==== cluster Randitem: Outputs a random item from a list.
valnum = ClusterInput()  # Number of Values
subtraction = Subtraction(A=valnum, B=1)
list = ClusterInput()
seed = ClusterInput()
construct_domain = ConstructDomain(DomainStart=0, DomainEnd=subtraction)
random = Random(Range=construct_domain, Number=1, Seed=seed)
round = Round(Number=random)  # -> Nearest, Floor, Ceiling
list_item = ListItem(List=list, Index=round.Nearest, Wrap=True)
debugid = ClusterOutput(round.Nearest)  # debug index
i = ClusterOutput(list_item)
